# Grasshopper definition Snitch.gh (Grasshopper 1.0.7)
# plug-ins: Grasshopper-Tekla Link 2021.1.14, jSwan, Heteroptera, SnitchGrasshopper, Wombat

mo = ModelObject(
    [null x167],
    ModelID="Snitch.db1",
    ModelObjectInfos=["Tekla.Structures.Model.Assembly, Tekla.Structures.Model, Version=2021.0.0.0, Culture=neutral, PublicKeyToken=2f04dbe497b71114;2a9a0b24-2b30-4f55-875e-6056699b7a65", "Tekla.Structures.Model.Assembly, Tekla.Structures.Model, Version=2021.0.0.0, Culture=neutral, PublicKeyToken=2f04dbe497b71114;5b2b07f3-2e87-4266-86e2-8aea8f9bdae8", "Tekla.Structures.Model.Assembly, Tekla.Structures.Model, Version=2021.0.0.0, Culture=neutral, PublicKeyToken=2f04dbe497b71114;9c5f5a10-b8a3-4b89-bd33-3c561e9ed753", "Tekla.Structures.Model.Assembly, Tekla.Structures.Model, Version=2021.0.0.0, Culture=neutral, PublicKeyToken=2f04dbe497b71114;417cfea4-24db-403d-aef3-ba30cb4f890d", "Tekla.Structures.Model.Assembly, Tekla.Structures.Model, Version=2021.0.0.0, Culture=neutral, PublicKeyToken=2f04dbe497b71114;a0a69e64-8209-49eb-9ab9-3a51e5ef31b1", "Tekla.Structures.Model.Assembly, Tekla.Structures.Model, Version=2021.0.0.0, Culture=neutral, PublicKeyToken=2f04dbe497b71114;2b013608-9cd4-47a3-b523-46ad5bb0b522"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])
mo_2 = ModelObject(simplify(graft(mo)))
deassembly = DeconstructAssembly(Assembly=mo_2)  # -> Name, Type, MainPart, Secondaries, AllObjects
pshift = ShiftPaths(Data=deassembly.AllObjects, Offset=-1)
clean = CleanTree(RemoveNulls=True, RemoveInvalid=True, RemoveEmpty=True, Tree=pshift)
cull_i = CullIndex(List=clean, Indices="0", Wrap=True)
item = ListItem(List=clean, Index="0", Wrap=True)

# ---- group: Rebars
rbr = Rebar(cull_i)
pshift_2 = ShiftPaths(Data=rbr, Offset=-1)
prop = GetProperty(TeklaObject=pshift_2, Name="WEIGHT", Type=0)
pshift_3 = ShiftPaths(Data=prop, Offset=-1)
ma = MassAddition(Input=pshift_3)  # -> Result, PartialResults

# ----
pt = ConstructPoint(XCoordinate="10", YCoordinate="10", ZCoordinate=0)
pt_2 = ConstructPoint(XCoordinate="10", YCoordinate=0, ZCoordinate=0)
pt_3 = ConstructPoint(XCoordinate=0, YCoordinate=0, ZCoordinate=0)
pline = PolyLine(Vertices=[pt_3, pt_2, pt], Closed=True)

# ---- group: Slabs
plt = Plate(item)
clean_2 = CleanTree(RemoveNulls=True, RemoveInvalid=True, RemoveEmpty=True, Tree=plt)
deplate = DeconstructPlate(Plate=clean_2)  # -> Boundary, Profile, Attributes, Position, Numbering, Type
mesh = ConvertToMesh(TeklaObject=clean_2, SolidType=2)
expattributes = ExpandPartAttributes(Attributes=deplate.Attributes)  # -> Name, Profile, Material, Finish, Class, Phase, UDA
cp = ControlPoints(Curve=deplate.Boundary)  # -> Points, Weights, Knots
pshift_4 = ShiftPaths(Data=mesh, Offset=-1)
panel = Panel("PLATE")
pshift_5 = ShiftPaths(Data=cp.Points, Offset=-1)
volume = Volume(Geometry=pshift_4)  # -> Volume, Centroid

# ----
multiplication = Multiplication(A=volume.Volume, B="10^-6")

# ---- group: Beam and columns
beam = Beam(item)
clean_3 = CleanTree(RemoveNulls=True, RemoveInvalid=True, RemoveEmpty=True, Tree=beam)
debeam = DeconstructBeam(Beam=clean_3)  # -> Curve, Profile, Attributes, Position, Numbering, Deforming, Type
mesh_2 = ConvertToMesh(TeklaObject=clean_3, SolidType=2)
expattributes_2 = ExpandPartAttributes(Attributes=debeam.Attributes)  # -> Name, Profile, Material, Finish, Class, Phase, UDA
cp_2 = ControlPoints(Curve=debeam.Curve)  # -> Points, Weights, Knots
pshift_6 = ShiftPaths(Data=mesh_2, Offset=-1)
pshift_7 = ShiftPaths(Data=cp_2.Points, Offset=-1)
tmatch = MatchText(Text=debeam.Type, Pattern="BEAM", Case=True)
tmatch_2 = MatchText(Text=debeam.Type, Pattern="COLUMN", Case=True)
volume_2 = Volume(Geometry=pshift_6)  # -> Volume, Centroid
dispatch = Dispatch(List=debeam.Curve, DispatchPattern=tmatch)  # -> ListA, ListB
tstat = TreeStatistics(Tree=dispatch.ListA)  # -> Paths, Length, Count
dispatch_2 = Dispatch(List=expattributes_2.Material, DispatchPattern=tmatch_2)  # -> ListA, ListB
dispatch_3 = Dispatch(List=pshift_6, DispatchPattern=tmatch)  # -> ListA, ListB
dispatch_4 = Dispatch(List=debeam.Curve, DispatchPattern=tmatch_2)  # -> ListA, ListB
tstat_2 = TreeStatistics(Tree=dispatch_4.ListA)  # -> Paths, Length, Count
branch = TreeBranch(Tree=ma.Result, Path=tstat_2.Paths, MaintainPaths=True)
dispatch_5 = Dispatch(List=pshift_6, DispatchPattern=tmatch_2)  # -> ListA, ListB
branch_2 = TreeBranch(Tree=ma.Result, Path=tstat.Paths, MaintainPaths=True)
dispatch_6 = Dispatch(List=expattributes_2.Material, DispatchPattern=tmatch)  # -> ListA, ListB
panel_2 = Panel("50")

# ----
multiplication_2 = Multiplication(A=volume_2.Volume, B="10^-6")

# ---- group: Beam and columns (continued)
dispatch_7 = Dispatch(List=multiplication_2, DispatchPattern=tmatch_2)  # -> ListA, ListB
dispatch_8 = Dispatch(List=multiplication_2, DispatchPattern=tmatch_2)  # -> ListA, ListB
dispatch_9 = Dispatch(List=multiplication_2, DispatchPattern=tmatch)  # -> ListA, ListB
dispatch_10 = Dispatch(List=multiplication_2, DispatchPattern=tmatch)  # -> ListA, ListB
snitch_beam = SnitchBeam(
    Mesh=dispatch_3.ListA,
    Polyline=dispatch.ListA,
    ConcreteVolume=dispatch_9.ListA,
    SteelMass=branch_2,
    ConcreteClass=dispatch_6.ListA,
    Load="40")

# ----
long = LongestList(ListA=dispatch_5.ListA, ListB=panel_2, PaddingMode=2)  # -> ListA, flatten(ListB)
randomize = RandomizeNumbers(Number=long.ListB, Ratio=0.2)
unflatten = UnflattenTree(Tree=randomize, Guide=long.ListA)
snitch_column = SnitchColumn(
    Mesh=dispatch_5.ListA,
    Polyline=dispatch_4.ListA,
    ConcreteVolume=dispatch_8.ListA,
    SteelMass=branch,
    ConcreteClass=dispatch_2.ListA,
    Load=unflatten)

# ---- group: Slabs (continued)
tstat_3 = TreeStatistics(Tree=multiplication)  # -> Paths, Length, Count
branch_3 = TreeBranch(Tree=ma.Result, Path=tstat_3.Paths, MaintainPaths=True)

# ----
long_2 = LongestList(ListA=branch_3, ListB="2", PaddingMode=2)  # -> ListA, flatten(ListB)
randomize_2 = RandomizeNumbers(Number=long_2.ListB, Ratio=0.2)
unflatten_2 = UnflattenTree(Tree=randomize_2, Guide=long_2.ListA)

# ---- group: Slabs (continued)
snitch_slab = SnitchSlab(
    Mesh=pshift_4,
    Polyline=deplate.Boundary,
    ConcreteVolume=multiplication,
    SteelMass=branch_3,
    ConcreteClass=expattributes.Material,
    Thickness=expattributes.Profile,
    Load=unflatten_2)

# ----
merge = Merge(Data1=snitch_beam, Data2=snitch_column, Data3=snitch_slab)  # -> flatten(Result)
snitch_building = SnitchBuilding(ListOfBuildingObjects=merge, Voronois=pline)

# ---- group: Create JSON database
snitchobject = Data(snitch_building)
rejson = SerializeJson(SnitchObject=snitchobject, IncludeNullAndEmptyProperties=False)  # disabled
rejson_2 = SerializeJson(Building=snitchobject, IncludeNullAndEmptyProperties=False)
create_json = BooleanToggle(False)
c_script = CSharpScript()  # -> CurrentFolder
# ---------- c_script: C# usings ----------
using System.IO;
# ---------- c_script: C# ----------
    CurrentFolder = Path.GetDirectoryName(GrasshopperDocument.FilePath) + Path.DirectorySeparatorChar;
# ---------- end c_script ----------
join = TextJoin(Text=rejson, Join=",")
dejson = DeserializeJson(JSON=rejson_2, OutputsLocked=False)
concat = Concatenate(FragmentA=c_script, FragmentB="Database.json")
concat_2 = Concatenate(FragmentA="[", FragmentB=join, FragmentC="]")
writetxt = WriteToTextFile(Run=create_json, TextToWrite=dejson, FilePath=concat, Append=Toggle(False), NewOnly=False)
panel_3 = Panel(writetxt)

# ----
analyze_snitch_building = AnalyzeSnitchBuilding(Building=snitch_building)
